% Simulink data dictionary control_motor.sldd

SPD_KP = Simulink.Parameter(0, StorageClass="ExportedGlobal", DataType="single")
SPD_KI = Simulink.Parameter(0, StorageClass="ExportedGlobal", DataType="single")
SPD_KD = Simulink.Parameter(0, StorageClass="ExportedGlobal", DataType="single")
ANGLE_MAX = Simulink.Parameter(18, StorageClass="Define", DataType="single")
ANGLE_MIN = Simulink.Parameter(-18, StorageClass="Define", DataType="single")
ANGLE_INTERGRAL_MAX = Simulink.Parameter(50, StorageClass="Define", DataType="single")
ANGLE_INTERGRAL_MIN = Simulink.Parameter(-50, StorageClass="Define", DataType="single")
TURN_KP = Simulink.Parameter(0, StorageClass="ExportedGlobal", DataType="single")
TURN_KD = Simulink.Parameter(0, StorageClass="ExportedGlobal", DataType="single")
bal_ec_max = Simulink.Parameter(4.38, StorageClass="Define", DataType="single")
bal_e_max = Simulink.Parameter(30, StorageClass="Define", DataType="single")
bal_kp_factor = Simulink.Parameter(0, StorageClass="ExportedGlobal", DataType="single")
bal_ki_factor = Simulink.Parameter(0, StorageClass="ExportedGlobal", DataType="single")
bal_kd_factor = Simulink.Parameter(0, StorageClass="ExportedGlobal", DataType="single")
BALANCE_KP = Simulink.Parameter(15, StorageClass="ExportedGlobal", DataType="single")
BALANCE_KD = Simulink.Parameter(0, StorageClass="ExportedGlobal", DataType="single")
PWM_MAX = Simulink.Parameter(800, StorageClass="Define", DataType="int16")
PWM_MIN = Simulink.Parameter(-800, StorageClass="Define", DataType="int16")
pitch_max = Simulink.Parameter(55, StorageClass="Define", DataType="single")
pitch_min = Simulink.Parameter(-55, StorageClass="Define", DataType="single")
spd_kff = Simulink.Parameter(0, StorageClass="ExportedGlobal", DataType="single")
BALANCE_KI = Simulink.Parameter(0, StorageClass="ExportedGlobal", DataType="single")